# Grasshopper definition CLT BF Calc.gh (Grasshopper 1.0.8)
# plug-ins: ShapeDiverForGrasshopper

sddp = ShapeDiverDocumentPayload({AbsoluteTolerance=0, AngleTolerance=0, DistanceDisplayPrecision=0, GltfVersion="Gltf2", GrasshopperVersion="1.0.0008", InputGroups="{}", OutputGroups="{}", RelativeTolerance=0, RhinoVersion="8.10.24228.13001", UnitSystem=0, VersionCreated="1.18.1.0", VersionSaved="1.19.0.0"})

# ---- group: Fibre Stock Properties
stock_material_length_ft = Slider(12, range=10..20)
stock_material_size = ValueList({"2 x 4": "{0;0}", "2 x 6": "{0;1}", "2 x 8": "{0;2}", "2 x 10": "{0;3}"}, selected="2 x 8")
overage_oaw = BooleanToggle(True)
planing_removal_width_mm = DirectTextInput(maxlength=10000, text="5")

# ---- group: Waste & Overages
finger_jointer_waste = Slider(3, range=1..5)
ordering_overage = Slider(0, range=0..25)

# ---- group: Billet Properties
layers = Slider(3, range=3..9)
overage_for_oal = BooleanToggle(False)
billet_x_in = DirectTextInput(maxlength=10000, text="96")
billet_y_in = DirectTextInput(maxlength=10000, text="144")
billet_z_mm = DirectTextInput(maxlength=10000, text="105")
billet_overage_xy_sides_in = DirectTextInput(maxlength=10000, text="1")

# ----
num = Number(billet_z_mm)
eval = Evaluate(F="If(x = False,2,1)*y", x=overage_for_oal, y=billet_overage_xy_sides_in)
addition = Addition(A=100, B=finger_jointer_waste)
_2x4 = Panel("""1.5
3.5
2
4""")
_2x6 = Panel("""1.5
5.5
2
6""")
_2x8 = Panel("""1.5
7.25
2
8""")
_2x8_2 = Panel("""1.5
9.25
2
10""")
num_2 = Number(billet_x_in)
num_3 = Number(billet_y_in)
division = Division(A=num, B=layers)
c_units = ConvertUnits(Data=stock_material_length_ft, Source=9, Target=2)
multiplication = Multiplication(A=addition, B=0.01)
division_2 = Division(A=layers, B=2)
lamella_thickness_mm = Panel(division)
round = Round(Number=division_2)  # -> Nearest, Floor, Ceiling
entwine = Entwine(Branch00=_2x4, Branch01=_2x6, Branch02=_2x8, Branch03=_2x8_2, FlattenInputs=True)
subtraction = Subtraction(A=layers, B=round.Ceiling)
branch = TreeBranch(Tree=entwine, Path=stock_material_size, MaintainPaths=True)  # -> graft(Branch)
num_4 = Number(branch)
bang = ExplodeTree(Data=num_4)  # -> Branch0, Branch1, Branch2, Branch3
addition_2 = Addition(A=100, B=ordering_overage)
multiplication_2 = Multiplication(A=addition_2, B=0.01)
c_units_2 = ConvertUnits(Data=bang.Branch0, Source=8, Target=2)
expression = Expression(x=division, y=c_units_2, Expression="If(x>y,\"Warning: stock material too small for lamella thickness\",\"\")")
thickness_warning = Panel(expression)
c_units_3 = ConvertUnits(Data=bang.Branch1, Source=8, Target=2)
eval_2 = Evaluate(F="If(x = False,2,1)*y", x=overage_oaw, y=planing_removal_width_mm)
subtraction_2 = Subtraction(A=c_units_3, B=eval_2)
multiplication_3 = Multiplication(A=c_units_2, B=c_units_3)
multiplication_4 = Multiplication(A=division, B=subtraction_2)
division_3 = Division(A=multiplication_4, B=multiplication_3)
bf_calculator = Expression(T=bang.Branch2, W=bang.Branch3, L=stock_material_length_ft, Expression="T*W*L/12")
multiplication_5 = Multiplication(A=division_3, B=100)
bf_to_m3_conversion = Panel("0.0023597372")
expression_2 = Expression(x=multiplication_5, Expression="Round(x,2) & \"%\"")
expression_3 = Expression(x=division, Expression="x & \"mm\"")
addition_3 = Addition(A=num_2, B=eval)
stock_profile_efficiency = Panel(expression_2)
addition_4 = Addition(A=num_3, B=eval)
layer_thickness = Panel(expression_3)
c_units_4 = ConvertUnits(Data=num_2, Source=8, Target=2)
c_units_5 = ConvertUnits(Data=num_3, Source=8, Target=2)
c_units_6 = ConvertUnits(Data=addition_3, Source=8, Target=2)
division_4 = Division(A=c_units_6, B=subtraction_2)
round_2 = Round(Number=division_4)  # -> Nearest, Floor, Ceiling
profile_efficiency = DirectDataOutput(Data=expression_2)
layer_thickness_2 = DirectDataOutput(Data=expression_3)
c_units_7 = ConvertUnits(Data=addition_4, Source=8, Target=2)
division_5 = Division(A=c_units_7, B=subtraction_2)
round_3 = Round(Number=division_5)  # -> Nearest, Floor, Ceiling
multiplication_6 = Multiplication(A=round_3.Ceiling, B=c_units_6)
multiplication_7 = Multiplication(A=round_2.Ceiling, B=c_units_7)
multiplication_8 = Multiplication(A=multiplication_7, B=round.Ceiling)
multiplication_9 = Multiplication(A=multiplication_6, B=subtraction)
addition_5 = Addition(A=multiplication_8, B=multiplication_9)
division_6 = Division(A=addition_5, B=c_units)
round_4 = Round(Number=division_6)  # -> Nearest, Floor, Ceiling
multiplication_10 = Multiplication(A=round_4.Ceiling, B=bf_calculator)
multiplication_11 = Multiplication(A=multiplication_10, B=multiplication)
multiplication_12 = Multiplication(A=multiplication_11, B=multiplication_2)
round_5 = Round(Number=multiplication_12)  # -> Nearest, Floor, Ceiling
multiplication_13 = Multiplication(A=multiplication_12, B=bf_to_m3_conversion)
eval_3 = Evaluate(F="x & \" bf\"", x=round_5.Ceiling)
required_bf = Panel(round_5.Ceiling)
eval_4 = Evaluate(F="Format(\"{0:0.000}\", x)", x=multiplication_13)
required_m_3 = Panel(eval_4)
eval_5 = Evaluate(F="x & \" m³\"", x=eval_4)
fibre_order_bf = DirectDataOutput(Data=eval_3)
fibre_order_m3 = DirectDataOutput(Data=eval_5)
box = CenterBox(Base=PlaneXY(0, 0, 0), X=expr("x/2", c_units_4), Y=expr("x/2", c_units_5), Z=expr("x/2", num))

# ---- group: Preview Geometry
box_2 = CenterBox(Base=PlaneXY(0, 0, 0), X=expr("x/2", c_units_6), Y=expr("x/2", c_units_7), Z=expr("x/2", num))

# ----
debrep = DeconstructBrep(Brep=box_2)  # -> Faces, Edges, Vertices
c_units_8 = ConvertUnits(Data=billet_z_mm, Source=2, Target=8)
item = ListItem(List=debrep.Edges, Index=1, Wrap=True)
item_2 = ListItem(List=debrep.Edges, Index=0, Wrap=True)
item_3 = ListItem(List=debrep.Edges, Index=10, Wrap=True)
division_7 = Division(A=1, B=layers)
debrep_2 = DeconstructBrep(Brep=box)  # -> Faces, Edges, Vertices
series = Series(Start=division_7, Step=division_7, Count=expr("x-1", layers))
expression_4 = Expression(x=series, Expression="Format(\"0, {0}, 0\", x)")
merge = Merge(Data1=item_2, Data2=item, Data3=item_3)
item_4 = ListItem(List=debrep_2.Faces, Index=[0, 1, 2, 3], Wrap=True)
panel = Panel(merge)
iso = IsoCurve(Surface=reparameterize(graft(item_4)), UVPoint=expression_4)  # -> UIsocurve, VIsocurve
panel_2 = Panel("30")
xy = XYPlane(Origin=Point(0, 0, 0))
eval_6 = EvaluateLength(Curve=[item_2, item], Length=0.5, Normalized=True)  # -> Point, Tangent, Parameter
panel_3 = Panel("""0,0.33
0,0.66""")
crv = Curve(iso.UIsocurve)
vec2pt = Vector2Pt(PointA=xy, PointB=eval_6.Point, Unitize=False)  # -> Vector, Length
devec = DeconstructVector(Vector=vec2pt.Vector)  # -> XComponent, YComponent, ZComponent
vec = VectorXYZ(XComponent=devec.XComponent, YComponent=devec.YComponent, ZComponent=0)  # -> Vector, Length
unit = UnitVector(Vector=vec.Vector)
end = EndPoints(Curve=merge)  # -> Start, End
merge_2 = Merge(Data1=graft(end.Start), Data2=graft(end.End))
multiplication_14 = Multiplication(A=unit, B="150")
flip = FlipMatrix(Data=merge_2)
multiplication_15 = Multiplication(A=unit, B="50")
move = Move(Geometry=merge, Motion=multiplication_14)  # -> Geometry, Transform
move_2 = Move(Geometry=flip, Motion=multiplication_15)  # -> Geometry, Transform
addition_6 = Addition(A="50", B="150")
eval_7 = EvaluateLength(Curve=move.Geometry, Length=0.5, Normalized=True)  # -> Point, Tangent, Parameter
multiplication_16 = Multiplication(A=unit, B=addition_6)
end_2 = EndPoints(Curve=move.Geometry)  # -> Start, End
eval_8 = EvaluateLength(Curve=merge, Length=0.5, Normalized=True)  # -> Point, Tangent, Parameter
move_3 = Move(Geometry=flip, Motion=multiplication_16)  # -> Geometry, Transform
vec2pt_2 = Vector2Pt(PointA=end_2.Start, PointB=end_2.End, Unitize=False)  # -> Vector, Length
vec2pt_3 = Vector2Pt(PointA=eval_7.Point, PointB=eval_8.Point, Unitize=False)  # -> Vector, Length
ln = Line(StartPoint=move_2.Geometry, EndPoint=move_3.Geometry)
len = Length(Curve=move.Geometry)
combine = CombineData(Input0=[addition_3, addition_4, c_units_8])  # -> Result, Index
pl = ConstructPlane(Origin=eval_7.Point, XAxis=vec2pt_2.Vector, YAxis=vec2pt_3.Vector)
num_5 = Number(len)
num_6 = Number(combine.Result)
move_4 = Move(Geometry=pl, Motion=multiplication_15)  # -> Geometry, Transform
eval_9 = Evaluate(F="Format(\"{0:0.000}\", x)", x=num_6)
eval_10 = Evaluate(F="Format(\"{0:0.00}\", x)", x=num_5)
concat = Concatenate(FragmentA=eval_10, FragmentB=" mm")
concat_2 = Concatenate(FragmentC="[", FragmentD=eval_9, FragmentE=" in.]")
flip_2 = FlipMatrix(Data=simplify(flatten(concat)))
flip_3 = FlipMatrix(Data=concat_2)
len_2 = TextLength(Text=flip_2)
len_3 = TextLength(Text=flip_3)
panel_4 = Panel(eval_9)
join = TextJoin(Text=[flip_2, flip_3])
subtraction_3 = Subtraction(A=len_2, B=len_3)
division_8 = Division(A=subtraction_3, B=2)
flip_4 = FlipMatrix(Data=join)
panel_5 = Panel(division_8)
crv_2 = Curve(debrep.Edges)
dash = DashPattern(Curve=crv_2, Pattern="80")  # -> Dashes, Gaps
crv_3 = Curve(dash.Dashes)

# ---- group: ignore these
swatch = ColourSwatch(SwatchColor=RGB(138, 120, 29))
swatch_2 = ColourSwatch(SwatchColor=RGB(0, 0, 0))
swatch_3 = ColourSwatch(SwatchColor=RGB(219, 190, 46))
swatch_4 = ColourSwatch(SwatchColor=RGB(76, 76, 76))

# ----
tag = TextTag3D(Location=move_4.Geometry, Text=flip_4, Size="60", Colour=swatch_2, Justification=5)
gltf2material = GlTF20Material(
    BaseColorFactor=swatch_2,
    MetallicFactor=0,
    RoughnessFactor=1,
    EmissiveFactor=RGB(0, 0, 0),
    AlphaMode="OPAQUE",
    AlphaCutoff=0.5,
    DoubleSided=True)
gltf2material_2 = GlTF20Material(
    BaseColorFactor=swatch,
    MetallicFactor=0,
    RoughnessFactor=1,
    EmissiveFactor=RGB(0, 0, 0),
    AlphaMode="OPAQUE",
    AlphaCutoff=0.5,
    DoubleSided=True)
gltf2material_3 = GlTF20Material(
    BaseColorFactor=swatch_3,
    MetallicFactor=0,
    RoughnessFactor=1,
    EmissiveFactor=RGB(0, 0, 0),
    AlphaMode="OPAQUE",
    AlphaCutoff=0.5,
    DoubleSided=True)
gltf2material_4 = GlTF20Material(
    BaseColorFactor=swatch_4,
    MetallicFactor=0,
    RoughnessFactor=1,
    EmissiveFactor=RGB(0, 0, 0),
    AlphaMode="OPAQUE",
    AlphaCutoff=0.5,
    DoubleSided=True)
clt_display = GlTF20Display(Geometry=[crv, debrep_2.Edges], Material=gltf2material_2)
clt_display_2 = GlTF20Display(Geometry=[box, crv], Material=gltf2material_3)
dim_display = GlTF20Display(Geometry=[debrep_2.Edges, move.Geometry], Material=gltf2material)
dim_display_2 = GlTF20Display(Geometry=[move.Geometry, ln, crv_3], Material=gltf2material_4)
